% Requirement links of Test3.mldatx (R2023b)

item 1 verifies -1:158168:20828:1:010420241807#01_Park Assist: Test3.mldatx/New Test Case 1:0
item 1 verifies -1:158168:20833:1:030420241520#During manoeuvring, if any of the interrupt conditions are met the system should go into Interrupt State.: Test3.mldatx/New Test Case 1:1
item 1 verifies -1:158168:20834:1:030420241521##02_Surround View: Test3.mldatx/New Test Case 1:2
item 2 verifies -1:158168:20833:1:010420241809#During manoeuvring, if any of the interrupt conditions are met the system should go into Interrupt State.: Test3.mldatx/New Test Case 2:0