% Requirement links of untitled3.slx (R2023b)

block :1 implements -1:158144:20766:1:010420241750#01_Park Assist: (untitled3/Data Type Conversion -> 01_Park Assist) [!1657629089091.png#fcd35c36131664b4cbc53875d171ba59!]
block :1 implements -1:158144:20767:1:010420241750#The vehicle shall be able to perform automated parallel parking if there are suitable space available.: (untitled3/Data Type Conversion -> The vehicle shall be able to perform automated parallel parking if there are suitable space available.) ~-~-
block :1 implements -1:158144:20768:1:010420241751#The vehicle shall be able to perform automated perpendicular parking if there are suitable space available.: (untitled3/Data Type Conversion -> The vehicle shall be able to perform automated perpendicular parking if there are suitable space available.) ~-~-
block :2 implements -1:158168:20828:1:010420241751#01_Park Assist: (untitled3/Constant -> 01_Park Assist) --
block :2 implements -1:158168:20833:1:010420241752#During manoeuvring, if any of the interrupt conditions are met the system should go into Interrupt State.: (untitled3/Constant -> During manoeuvring, if any of the interrupt conditions are met the system should go into Interrupt State.) The Park Assist function is an aiding system in most modern cars which helps drivers while parking in narrow spaces. If this system is not functioning correctly for some reason~, then you will receive a message or warning telling you that park assist is blocked. If you see the message “Park Assist Blocked See Owners Manual~,” visit a professional mechanic.
block :3 implements -1:158155:20810:1:010420241753#Architecture Diagram: (untitled3/Constant1 -> Architecture Diagram) [{MxGraph format='image' mxdata:PHJvb3Q+PG1vZGVsPjxteEdyYXBoTW9kZWwgZHg9IjE0MjYiIGR5PSI2NjciIGdyaWQ9IjEiIGdyaWRTaXplPSIxMCIgZ3VpZGVzPSIxIiB0b29sdGlwcz0iMSIgY29ubmVjdD0iMSIgYXJyb3dzPSIxIiBmb2xkPSIxIiBwYWdlPSIxIiBwYWdlU2NhbGU9IjEiIHBhZ2VXaWR0aD0iODI3IiBwYWdlSGVpZ2h0PSIxMTY5Ij48cm9vdD48bXhDZWxsIGlkPSIwIi8+PG14Q2VsbCBpZD0iMSIgcGFyZW50PSIwIi8+PG14Q2VsbCBpZD0iMTIiIHZhbHVlPSJBY3R1YXRvcnMiIHN0eWxlPSJyb3VuZGVkPTA7d2hpdGVTcGFjZT13cmFwO2h0bWw9MTtmaWxsQ29sb3I9I0U2RkZDQzthbGlnbj1sZWZ0O3ZlcnRpY2FsQWxpZ249dG9wO2ZvbnRTdHlsZT0xO2ZvbnRTaXplPTE2OyIgcGFyZW50PSIxIiB2ZXJ0ZXg9IjEiPjxteEdlb21ldHJ5IHg9IjYyMCIgeT0iNTAiIHdpZHRoPSIyNjAiIGhlaWdodD0iMzEwIiBhcz0iZ2VvbWV0cnkiLz48L214Q2VsbD48bXhDZWxsIGlkPSI3IiB2YWx1ZT0iU2Vuc29ycyIgc3R5bGU9InJvdW5kZWQ9MDt3aGl0ZVNwYWNlPXdyYXA7aHRtbD0xO2ZpbGxDb2xvcj0jRkZGRkNDO2FsaWduPWxlZnQ7dmVydGljYWxBbGlnbj10b3A7Zm9udFN0eWxlPTE7Zm9udFNpemU9MTY7IiBwYXJlbnQ9IjEiIHZlcnRleD0iMSI+PG14R2VvbWV0cnkgeD0iNDkiIHk9IjUwIiB3aWR0aD0iMjYwIiBoZWlnaHQ9IjMxMCIgYXM9Imdlb21ldHJ5Ii8+PC9teENlbGw+PG14Q2VsbCBpZD0iMTkiIHN0eWxlPSJlZGdlU3R5bGU9b3J0aG9nb25hbEVkZ2VTdHlsZTtyb3VuZGVkPTA7b3J0aG9nb25hbExvb3A9MTtqZXR0eVNpemU9YXV0bztodG1sPTE7ZXhpdFg9MC41O2V4aXRZPTA7ZXhpdER4PTA7ZXhpdER5PTA7ZW50cnlYPTAuNTtlbnRyeVk9MTtlbnRyeUR4PTA7ZW50cnlEeT0wOyIgcGFyZW50PSIxIiBzb3VyY2U9IjIiIHRhcmdldD0iMTAiIGVkZ2U9IjEiPjxteEdlb21ldHJ5IHJlbGF0aXZlPSIxIiBhcz0iZ2VvbWV0cnkiLz48L214Q2VsbD48bXhDZWxsIGlkPSIyIiB2YWx1ZT0iTG93U3BlZWQgTW9kdWxlIiBzdHlsZT0icm91bmRlZD0wO3doaXRlU3BhY2U9d3JhcDtodG1sPTE7ZmlsbENvbG9yPSM2NkIyRkY7IiBwYXJlbnQ9IjEiIHZlcnRleD0iMSI+PG14R2VvbWV0cnkgeD0iNDA0LjUiIHk9IjI1MCIgd2lkdGg9IjEyMCIgaGVpZ2h0PSI2MCIgYXM9Imdlb21ldHJ5Ii8+PC9teENlbGw+PG14Q2VsbCBpZD0iMTciIHN0eWxlPSJlZGdlU3R5bGU9b3J0aG9nb25hbEVkZ2VTdHlsZTtyb3VuZGVkPTA7b3J0aG9nb25hbExvb3A9MTtqZXR0eVNpemU9YXV0bztodG1sPTE7ZXhpdFg9MTtleGl0WT0wLjU7ZXhpdER4PTA7ZXhpdER5PTA7ZW50cnlYPTA7ZW50cnlZPTAuNzU7ZW50cnlEeD0wO2VudHJ5RHk9MDsiIHBhcmVudD0iMSIgc291cmNlPSIzIiB0YXJnZXQ9IjIiIGVkZ2U9IjEiPjxteEdlb21ldHJ5IHJlbGF0aXZlPSIxIiBhcz0iZ2VvbWV0cnkiLz48L214Q2VsbD48bXhDZWxsIGlkPSIzIiB2YWx1ZT0iRm9yd2FyZCBWaXNpb24gQ2FtZXJhIiBzdHlsZT0icm91bmRlZD0wO3doaXRlU3BhY2U9d3JhcDtodG1sPTE7ZmlsbENvbG9yPSNDQ0ZGRkY7IiBwYXJlbnQ9IjEiIHZlcnRleD0iMSI+PG14R2VvbWV0cnkgeD0iMTEwIiB5PSIxNzUiIHdpZHRoPSIxMjAiIGhlaWdodD0iNjAiIGFzPSJnZW9tZXRyeSIvPjwvbXhDZWxsPjxteENlbGwgaWQ9IjI1IiBzdHlsZT0iZWRnZVN0eWxlPW9ydGhvZ29uYWxFZGdlU3R5bGU7cm91bmRlZD0wO29ydGhvZ29uYWxMb29wPTE7amV0dHlTaXplPWF1dG87aHRtbD0xO2V4aXRYPTAuNTtleGl0WT0wO2V4aXREeD0wO2V4aXREeT0wO2VudHJ5WD0wLjU7ZW50cnlZPTE7ZW50cnlEeD0wO2VudHJ5RHk9MDsiIHBhcmVudD0iMSIgc291cmNlPSI0IiB0YXJnZXQ9IjciIGVkZ2U9IjEiPjxteEdlb21ldHJ5IHJlbGF0aXZlPSIxIiBhcz0iZ2VvbWV0cnkiLz48L214Q2VsbD48bXhDZWxsIGlkPSIyNiIgc3R5bGU9ImVkZ2VTdHlsZT1vcnRob2dvbmFsRWRnZVN0eWxlO3JvdW5kZWQ9MDtvcnRob2dvbmFsTG9vcD0xO2pldHR5U2l6ZT1hdXRvO2h0bWw9MTtleGl0WD0wLjU7ZXhpdFk9MDtleGl0RHg9MDtleGl0RHk9MDtlbnRyeVg9MC41O2VudHJ5WT0xO2VudHJ5RHg9MDtlbnRyeUR5PTA7IiBwYXJlbnQ9IjEiIHNvdXJjZT0iNCIgdGFyZ2V0PSIxMiIgZWRnZT0iMSI+PG14R2VvbWV0cnkgcmVsYXRpdmU9IjEiIGFzPSJnZW9tZXRyeSIvPjwvbXhDZWxsPjxteENlbGwgaWQ9IjQiIHZhbHVlPSJHYXRld2F5IE1vZHVsZSIgc3R5bGU9InJvdW5kZWQ9MDt3aGl0ZVNwYWNlPXdyYXA7aHRtbD0xO2ZpbGxDb2xvcj0jRkZDQzk5OyIgcGFyZW50PSIxIiB2ZXJ0ZXg9IjEiPjxteEdlb21ldHJ5IHg9IjQ5IiB5PSI0MDAiIHdpZHRoPSI4MzEiIGhlaWdodD0iNjAiIGFzPSJnZW9tZXRyeSIvPjwvbXhDZWxsPjxteENlbGwgaWQ9IjUiIHZhbHVlPSJDYXIgQ29uZmlndXJhdGlvbiIgc3R5bGU9InJvdW5kZWQ9MDt3aGl0ZVNwYWNlPXdyYXA7aHRtbD0xOyIgcGFyZW50PSIxIiB2ZXJ0ZXg9IjEiPjxteEdlb21ldHJ5IHg9IjExMCIgeT0iNDA1IiB3aWR0aD0iMTAwIiBoZWlnaHQ9IjUwIiBhcz0iZ2VvbWV0cnkiLz48L214Q2VsbD48bXhDZWxsIGlkPSIxOCIgc3R5bGU9ImVkZ2VTdHlsZT1vcnRob2dvbmFsRWRnZVN0eWxlO3JvdW5kZWQ9MDtvcnRob2dvbmFsTG9vcD0xO2pldHR5U2l6ZT1hdXRvO2h0bWw9MTtleGl0WD0xO2V4aXRZPTAuNTtleGl0RHg9MDtleGl0RHk9MDtlbnRyeVg9MDtlbnRyeVk9MC4yNTtlbnRyeUR4PTA7ZW50cnlEeT0wOyIgcGFyZW50PSIxIiBzb3VyY2U9IjYiIHRhcmdldD0iMiIgZWRnZT0iMSI+PG14R2VvbWV0cnkgcmVsYXRpdmU9IjEiIGFzPSJnZW9tZXRyeSIvPjwvbXhDZWxsPjxteENlbGwgaWQ9IjYiIHZhbHVlPSJVbHRyYVNvbmljIFNlbnNvcnMiIHN0eWxlPSJyb3VuZGVkPTA7d2hpdGVTcGFjZT13cmFwO2h0bWw9MTtmaWxsQ29sb3I9I0NDRkZGRjsiIHBhcmVudD0iMSIgdmVydGV4PSIxIj48bXhHZW9tZXRyeSB4PSIxMTAiIHk9IjI2MCIgd2lkdGg9IjEyMCIgaGVpZ2h0PSI2MCIgYXM9Imdlb21ldHJ5Ii8+PC9teENlbGw+PG14Q2VsbCBpZD0iMTYiIHN0eWxlPSJlZGdlU3R5bGU9b3J0aG9nb25hbEVkZ2VTdHlsZTtyb3VuZGVkPTA7b3J0aG9nb25hbExvb3A9MTtqZXR0eVNpemU9YXV0bztodG1sPTE7ZXhpdFg9MTtleGl0WT0wLjU7ZXhpdER4PTA7ZXhpdER5PTA7ZW50cnlYPTA7ZW50cnlZPTAuNTtlbnRyeUR4PTA7ZW50cnlEeT0wOyIgcGFyZW50PSIxIiBzb3VyY2U9IjgiIHRhcmdldD0iMiIgZWRnZT0iMSI+PG14R2VvbWV0cnkgcmVsYXRpdmU9IjEiIGFzPSJnZW9tZXRyeSIvPjwvbXhDZWxsPjxteENlbGwgaWQ9IjgiIHZhbHVlPSJTdXJyb3VuZCBDYW1lcmFzIiBzdHlsZT0icm91bmRlZD0wO3doaXRlU3BhY2U9d3JhcDtodG1sPTE7ZmlsbENvbG9yPSNDQ0ZGRkY7IiBwYXJlbnQ9IjEiIHZlcnRleD0iMSI+PG14R2VvbWV0cnkgeD0iMTEwIiB5PSI5MCIgd2lkdGg9IjEyMCIgaGVpZ2h0PSI2MCIgYXM9Imdlb21ldHJ5Ii8+PC9teENlbGw+PG14Q2VsbCBpZD0iMjAiIHN0eWxlPSJlZGdlU3R5bGU9b3J0aG9nb25hbEVkZ2VTdHlsZTtyb3VuZGVkPTA7b3J0aG9nb25hbExvb3A9MTtqZXR0eVNpemU9YXV0bztodG1sPTE7ZXhpdFg9MTtleGl0WT0wLjI1O2V4aXREeD0wO2V4aXREeT0wO2VudHJ5WD0wO2VudHJ5WT0wLjU7ZW50cnlEeD0wO2VudHJ5RHk9MDsiIHBhcmVudD0iMSIgc291cmNlPSIxMCIgdGFyZ2V0PSIxMyIgZWRnZT0iMSI+PG14R2VvbWV0cnkgcmVsYXRpdmU9IjEiIGFzPSJnZW9tZXRyeSIvPjwvbXhDZWxsPjxteENlbGwgaWQ9IjIxIiBzdHlsZT0iZWRnZVN0eWxlPW9ydGhvZ29uYWxFZGdlU3R5bGU7cm91bmRlZD0wO29ydGhvZ29uYWxMb29wPTE7amV0dHlTaXplPWF1dG87aHRtbD0xO2V4aXRYPTE7ZXhpdFk9MC41O2V4aXREeD0wO2V4aXREeT0wO2VudHJ5WD0wO2VudHJ5WT0wLjI1O2VudHJ5RHg9MDtlbnRyeUR5PTA7IiBwYXJlbnQ9IjEiIHNvdXJjZT0iMTAiIHRhcmdldD0iMTQiIGVkZ2U9IjEiPjxteEdlb21ldHJ5IHJlbGF0aXZlPSIxIiBhcz0iZ2VvbWV0cnkiLz48L214Q2VsbD48bXhDZWxsIGlkPSIyMiIgc3R5bGU9ImVkZ2VTdHlsZT1vcnRob2dvbmFsRWRnZVN0eWxlO3JvdW5kZWQ9MDtvcnRob2dvbmFsTG9vcD0xO2pldHR5U2l6ZT1hdXRvO2h0bWw9MTtleGl0WD0xO2V4aXRZPTAuNzU7ZXhpdER4PTA7ZXhpdER5PTA7ZW50cnlYPTA7ZW50cnlZPTAuMjU7ZW50cnlEeD0wO2VudHJ5RHk9MDsiIHBhcmVudD0iMSIgc291cmNlPSIxMCIgdGFyZ2V0PSIxNSIgZWRnZT0iMSI+PG14R2VvbWV0cnkgcmVsYXRpdmU9IjEiIGFzPSJnZW9tZXRyeSIvPjwvbXhDZWxsPjxteENlbGwgaWQ9IjEwIiB2YWx1ZT0iQURBUyBEb21haW4gQ29udHJvbGxlciIgc3R5bGU9IndoaXRlU3BhY2U9d3JhcDtodG1sPTE7YXNwZWN0PWZpeGVkO2ZpbGxDb2xvcj0jQ0NFNUZGOyIgcGFyZW50PSIxIiB2ZXJ0ZXg9IjEiPjxteEdlb21ldHJ5IHg9IjM3NC41IiB5PSI1NSIgd2lkdGg9IjE4MCIgaGVpZ2h0PSIxODAiIGFzPSJnZW9tZXRyeSIvPjwvbXhDZWxsPjxteENlbGwgaWQ9IjEzIiB2YWx1ZT0iQUJTIiBzdHlsZT0icm91bmRlZD0wO3doaXRlU3BhY2U9d3JhcDtodG1sPTE7ZmlsbENvbG9yPSNENUU4RDQ7IiBwYXJlbnQ9IjEiIHZlcnRleD0iMSI+PG14R2VvbWV0cnkgeD0iNzIwIiB5PSI5MCIgd2lkdGg9IjEyMCIgaGVpZ2h0PSI2MCIgYXM9Imdlb21ldHJ5Ii8+PC9teENlbGw+PG14Q2VsbCBpZD0iMTQiIHZhbHVlPSJFbmdpbmUgQ29udHJvbCBNb2R1bGUiIHN0eWxlPSJyb3VuZGVkPTA7d2hpdGVTcGFjZT13cmFwO2h0bWw9MTtmaWxsQ29sb3I9I0Q1RThENDsiIHBhcmVudD0iMSIgdmVydGV4PSIxIj48bXhHZW9tZXRyeSB4PSI3MjAiIHk9IjE2MCIgd2lkdGg9IjEyMCIgaGVpZ2h0PSI2MCIgYXM9Imdlb21ldHJ5Ii8+PC9teENlbGw+PG14Q2VsbCBpZD0iMTUiIHZhbHVlPSJFbGVjdHJpYyBQb3dlciBTdGVlcmluZyIgc3R5bGU9InJvdW5kZWQ9MDt3aGl0ZVNwYWNlPXdyYXA7aHRtbD0xO2ZpbGxDb2xvcj0jRDVFOEQ0OyIgcGFyZW50PSIxIiB2ZXJ0ZXg9IjEiPjxteEdlb21ldHJ5IHg9IjcyMCIgeT0iMjMwIiB3aWR0aD0iMTIwIiBoZWlnaHQ9IjYwIiBhcz0iZ2VvbWV0cnkiLz48L214Q2VsbD48L3Jvb3Q+PC9teEdyYXBoTW9kZWw+PC9tb2RlbD48c3RhdGU+PGluZm9BdHRyaWJ1dGVzPjxncmFwaFdpZHRoPjgzNDwvZ3JhcGhXaWR0aD48Z3JhcGhIZWlnaHQ+NDEzPC9ncmFwaEhlaWdodD48L2luZm9BdHRyaWJ1dGVzPjxvdXRwdXQ+PGZvbnRmYW1pbHkgZmFtaWx5PSJBcmlhbCBVbmljb2RlIE1TIi8+PGZvbnRzaXplIHNpemU9IjExIi8+PHNoYWRvd2NvbG9yIGNvbG9yPSIjMDAwMDAwIi8+PHNoYWRvd2FscGhhIGFscGhhPSIwLjI1Ii8+PHNoYWRvd29mZnNldCBkeD0iMiIgZHk9IjMiLz48dHJhbnNsYXRlIGR4PSItMTQ3NCIgZHk9Ii03MTYiLz48c2NhbGUgc2NhbGU9IjEiLz48c2F2ZS8+PHNjYWxlIHNjYWxlPSIxIi8+PGZpbGxjb2xvciBjb2xvcj0iI0U2RkZDQyIvPjxzdHJva2Vjb2xvciBjb2xvcj0iIzAwMDAwMCIvPjxyZWN0IHg9IjIwNDYiIHk9IjcxNyIgdz0iMjYwIiBoPSIzMTAiLz48ZmlsbHN0cm9rZS8+PHJlc3RvcmUvPjxzYXZlLz48c2NhbGUgc2NhbGU9IjEiLz48ZmlsbGNvbG9yIGNvbG9yPSIjRTZGRkNDIi8+PHN0cm9rZWNvbG9yIGNvbG9yPSIjMDAwMDAwIi8+PGZvbnRzaXplIHNpemU9IjE2Ii8+PGZvbnRzdHlsZSBzdHlsZT0iMSIvPjx0ZXh0IHg9IjIwNDgiIHk9IjcyNCIgdz0iMjU2IiBoPSIzMDYiIHN0cj0iQWN0dWF0b3JzIiBhbGlnbj0ibGVmdCIgdmFsaWduPSJ0b3AiIHdyYXA9IjEiIGZvcm1hdD0iaHRtbCIgb3ZlcmZsb3c9InZpc2libGUiIGNsaXA9IjAiIHJvdGF0aW9uPSIwIi8+PHJlc3RvcmUvPjxzYXZlLz48c2NhbGUgc2NhbGU9IjEiLz48ZmlsbGNvbG9yIGNvbG9yPSIjRkZGRkNDIi8+PHN0cm9rZWNvbG9yIGNvbG9yPSIjMDAwMDAwIi8+PHJlY3QgeD0iMTQ3NSIgeT0iNzE3IiB3PSIyNjAiIGg9IjMxMCIvPjxmaWxsc3Ryb2tlLz48cmVzdG9yZS8+PHNhdmUvPjxzY2FsZSBzY2FsZT0iMSIvPjxmaWxsY29sb3IgY29sb3I9IiNGRkZGQ0MiLz48c3Ryb2tlY29sb3IgY29sb3I9IiMwMDAwMDAiLz48Zm9udHNpemUgc2l6ZT0iMTYiLz48Zm9udHN0eWxlIHN0eWxlPSIxIi8+PHRleHQgeD0iMTQ3NyIgeT0iNzI0IiB3PSIyNTYiIGg9IjMwNiIgc3RyPSJTZW5zb3JzIiBhbGlnbj0ibGVmdCIgdmFsaWduPSJ0b3AiIHdyYXA9IjEiIGZvcm1hdD0iaHRtbCIgb3ZlcmZsb3c9InZpc2libGUiIGNsaXA9IjAiIHJvdGF0aW9uPSIwIi8+PHJlc3RvcmUvPjxzYXZlLz48c2NhbGUgc2NhbGU9IjEiLz48c3Ryb2tlY29sb3IgY29sb3I9IiMwMDAwMDAiLz48YmVnaW4vPjxtb3ZlIHg9IjE4OTAuNSIgeT0iOTE3Ii8+PGxpbmUgeD0iMTg5MC41IiB5PSI5MDguMzciLz48c3Ryb2tlLz48ZmlsbGNvbG9yIGNvbG9yPSIjMDAwMDAwIi8+PGJlZ2luLz48bW92ZSB4PSIxODkwLjUiIHk9IjkwMy4xMiIvPjxsaW5lIHg9IjE4OTQiIHk9IjkxMC4xMiIvPjxsaW5lIHg9IjE4OTAuNSIgeT0iOTA4LjM3Ii8+PGxpbmUgeD0iMTg4NyIgeT0iOTEwLjEyIi8+PGNsb3NlLz48ZmlsbHN0cm9rZS8+PHJlc3RvcmUvPjxzYXZlLz48c2NhbGUgc2NhbGU9IjEiLz48ZmlsbGNvbG9yIGNvbG9yPSIjNjZCMkZGIi8+PHN0cm9rZWNvbG9yIGNvbG9yPSIjMDAwMDAwIi8+PHJlY3QgeD0iMTgzMC41IiB5PSI5MTciIHc9IjEyMCIgaD0iNjAiLz48ZmlsbHN0cm9rZS8+PHJlc3RvcmUvPjxzYXZlLz48c2NhbGUgc2NhbGU9IjEiLz48ZmlsbGNvbG9yIGNvbG9yPSIjNjZCMkZGIi8+PHN0cm9rZWNvbG9yIGNvbG9yPSIjMDAwMDAwIi8+PGZvbnRzaXplIHNpemU9IjEyIi8+PHRleHQgeD0iMTg5MC41IiB5PSI5NDciIHc9IjExNiIgaD0iNTYiIHN0cj0iTG93U3BlZWQgTW9kdWxlIiBhbGlnbj0iY2VudGVyIiB2YWxpZ249Im1pZGRsZSIgd3JhcD0iMSIgZm9ybWF0PSJodG1sIiBvdmVyZmxvdz0idmlzaWJsZSIgY2xpcD0iMCIgcm90YXRpb249IjAiLz48cmVzdG9yZS8+PHNhdmUvPjxzY2FsZSBzY2FsZT0iMSIvPjxzdHJva2Vjb2xvciBjb2xvcj0iIzAwMDAwMCIvPjxiZWdpbi8+PG1vdmUgeD0iMTY1NiIgeT0iODcyIi8+PGxpbmUgeD0iMTc0My4zIiB5PSI4NzIiLz48bGluZSB4PSIxNzQzLjMiIHk9Ijk2MiIvPjxsaW5lIHg9IjE4MjQuMTMiIHk9Ijk2MiIvPjxzdHJva2UvPjxmaWxsY29sb3IgY29sb3I9IiMwMDAwMDAiLz48YmVnaW4vPjxtb3ZlIHg9IjE4MjkuMzgiIHk9Ijk2MiIvPjxsaW5lIHg9IjE4MjIuMzgiIHk9Ijk2NS41Ii8+PGxpbmUgeD0iMTgyNC4xMyIgeT0iOTYyIi8+PGxpbmUgeD0iMTgyMi4zOCIgeT0iOTU4LjUiLz48Y2xvc2UvPjxmaWxsc3Ryb2tlLz48cmVzdG9yZS8+PHNhdmUvPjxzY2FsZSBzY2FsZT0iMSIvPjxmaWxsY29sb3IgY29sb3I9IiNDQ0ZGRkYiLz48c3Ryb2tlY29sb3IgY29sb3I9IiMwMDAwMDAiLz48cmVjdCB4PSIxNTM2IiB5PSI4NDIiIHc9IjEyMCIgaD0iNjAiLz48ZmlsbHN0cm9rZS8+PHJlc3RvcmUvPjxzYXZlLz48c2NhbGUgc2NhbGU9IjEiLz48ZmlsbGNvbG9yIGNvbG9yPSIjQ0NGRkZGIi8+PHN0cm9rZWNvbG9yIGNvbG9yPSIjMDAwMDAwIi8+PGZvbnRzaXplIHNpemU9IjEyIi8+PHRleHQgeD0iMTU5NiIgeT0iODcyIiB3PSIxMTYiIGg9IjU2IiBzdHI9IkZvcndhcmQgVmlzaW9uIENhbWVyYSIgYWxpZ249ImNlbnRlciIgdmFsaWduPSJtaWRkbGUiIHdyYXA9IjEiIGZvcm1hdD0iaHRtbCIgb3ZlcmZsb3c9InZpc2libGUiIGNsaXA9IjAiIHJvdGF0aW9uPSIwIi8+PHJlc3RvcmUvPjxzYXZlLz48c2NhbGUgc2NhbGU9IjEiLz48c3Ryb2tlY29sb3IgY29sb3I9IiMwMDAwMDAiLz48YmVnaW4vPjxtb3ZlIHg9IjE4OTAuNSIgeT0iMTA2NyIvPjxsaW5lIHg9IjE4OTAuNSIgeT0iMTA0NyIvPjxsaW5lIHg9IjE2MDUiIHk9IjEwNDciLz48bGluZSB4PSIxNjA1IiB5PSIxMDMzLjM3Ii8+PHN0cm9rZS8+PGZpbGxjb2xvciBjb2xvcj0iIzAwMDAwMCIvPjxiZWdpbi8+PG1vdmUgeD0iMTYwNSIgeT0iMTAyOC4xMiIvPjxsaW5lIHg9IjE2MDguNSIgeT0iMTAzNS4xMiIvPjxsaW5lIHg9IjE2MDUiIHk9IjEwMzMuMzciLz48bGluZSB4PSIxNjAxLjUiIHk9IjEwMzUuMTIiLz48Y2xvc2UvPjxmaWxsc3Ryb2tlLz48cmVzdG9yZS8+PHNhdmUvPjxzY2FsZSBzY2FsZT0iMSIvPjxzdHJva2Vjb2xvciBjb2xvcj0iIzAwMDAwMCIvPjxiZWdpbi8+PG1vdmUgeD0iMTg5MC41IiB5PSIxMDY3Ii8+PGxpbmUgeD0iMTg5MC41IiB5PSIxMDQ3Ii8+PGxpbmUgeD0iMjE3NiIgeT0iMTA0NyIvPjxsaW5lIHg9IjIxNzYiIHk9IjEwMzMuMzciLz48c3Ryb2tlLz48ZmlsbGNvbG9yIGNvbG9yPSIjMDAwMDAwIi8+PGJlZ2luLz48bW92ZSB4PSIyMTc2IiB5PSIxMDI4LjEyIi8+PGxpbmUgeD0iMjE3OS41IiB5PSIxMDM1LjEyIi8+PGxpbmUgeD0iMjE3NiIgeT0iMTAzMy4zNyIvPjxsaW5lIHg9IjIxNzIuNSIgeT0iMTAzNS4xMiIvPjxjbG9zZS8+PGZpbGxzdHJva2UvPjxyZXN0b3JlLz48c2F2ZS8+PHNjYWxlIHNjYWxlPSIxIi8+PGZpbGxjb2xvciBjb2xvcj0iI0ZGQ0M5OSIvPjxzdHJva2Vjb2xvciBjb2xvcj0iIzAwMDAwMCIvPjxyZWN0IHg9IjE0NzUiIHk9IjEwNjciIHc9IjgzMSIgaD0iNjAiLz48ZmlsbHN0cm9rZS8+PHJlc3RvcmUvPjxzYXZlLz48c2NhbGUgc2NhbGU9IjEiLz48ZmlsbGNvbG9yIGNvbG9yPSIjRkZDQzk5Ii8+PHN0cm9rZWNvbG9yIGNvbG9yPSIjMDAwMDAwIi8+PGZvbnRzaXplIHNpemU9IjEyIi8+PHRleHQgeD0iMTg5MC41IiB5PSIxMDk3IiB3PSI4MjciIGg9IjU2IiBzdHI9IkdhdGV3YXkgTW9kdWxlIiBhbGlnbj0iY2VudGVyIiB2YWxpZ249Im1pZGRsZSIgd3JhcD0iMSIgZm9ybWF0PSJodG1sIiBvdmVyZmxvdz0idmlzaWJsZSIgY2xpcD0iMCIgcm90YXRpb249IjAiLz48cmVzdG9yZS8+PHNhdmUvPjxzY2FsZSBzY2FsZT0iMSIvPjxmaWxsY29sb3IgY29sb3I9IiNmZmZmZmYiLz48c3Ryb2tlY29sb3IgY29sb3I9IiMwMDAwMDAiLz48cmVjdCB4PSIxNTM2IiB5PSIxMDcyIiB3PSIxMDAiIGg9IjUwIi8+PGZpbGxzdHJva2UvPjxyZXN0b3JlLz48c2F2ZS8+PHNjYWxlIHNjYWxlPSIxIi8+PGZpbGxjb2xvciBjb2xvcj0iI2ZmZmZmZiIvPjxzdHJva2Vjb2xvciBjb2xvcj0iIzAwMDAwMCIvPjxmb250c2l6ZSBzaXplPSIxMiIvPjx0ZXh0IHg9IjE1ODYiIHk9IjEwOTciIHc9Ijk2IiBoPSI0NiIgc3RyPSJDYXIgQ29uZmlndXJhdGlvbiIgYWxpZ249ImNlbnRlciIgdmFsaWduPSJtaWRkbGUiIHdyYXA9IjEiIGZvcm1hdD0iaHRtbCIgb3ZlcmZsb3c9InZpc2libGUiIGNsaXA9IjAiIHJvdGF0aW9uPSIwIi8+PHJlc3RvcmUvPjxzYXZlLz48c2NhbGUgc2NhbGU9IjEiLz48c3Ryb2tlY29sb3IgY29sb3I9IiMwMDAwMDAiLz48YmVnaW4vPjxtb3ZlIHg9IjE2NTYiIHk9Ijk1NyIvPjxsaW5lIHg9IjE3NDMuMyIgeT0iOTU3Ii8+PGxpbmUgeD0iMTc0My4zIiB5PSI5MzIiLz48bGluZSB4PSIxODI0LjEzIiB5PSI5MzIiLz48c3Ryb2tlLz48ZmlsbGNvbG9yIGNvbG9yPSIjMDAwMDAwIi8+PGJlZ2luLz48bW92ZSB4PSIxODI5LjM4IiB5PSI5MzIiLz48bGluZSB4PSIxODIyLjM4IiB5PSI5MzUuNSIvPjxsaW5lIHg9IjE4MjQuMTMiIHk9IjkzMiIvPjxsaW5lIHg9IjE4MjIuMzgiIHk9IjkyOC41Ii8+PGNsb3NlLz48ZmlsbHN0cm9rZS8+PHJlc3RvcmUvPjxzYXZlLz48c2NhbGUgc2NhbGU9IjEiLz48ZmlsbGNvbG9yIGNvbG9yPSIjQ0NGRkZGIi8+PHN0cm9rZWNvbG9yIGNvbG9yPSIjMDAwMDAwIi8+PHJlY3QgeD0iMTUzNiIgeT0iOTI3IiB3PSIxMjAiIGg9IjYwIi8+PGZpbGxzdHJva2UvPjxyZXN0b3JlLz48c2F2ZS8+PHNjYWxlIHNjYWxlPSIxIi8+PGZpbGxjb2xvciBjb2xvcj0iI0NDRkZGRiIvPjxzdHJva2Vjb2xvciBjb2xvcj0iIzAwMDAwMCIvPjxmb250c2l6ZSBzaXplPSIxMiIvPjx0ZXh0IHg9IjE1OTYiIHk9Ijk1NyIgdz0iMTE2IiBoPSI1NiIgc3RyPSJVbHRyYVNvbmljIFNlbnNvcnMiIGFsaWduPSJjZW50ZXIiIHZhbGlnbj0ibWlkZGxlIiB3cmFwPSIxIiBmb3JtYXQ9Imh0bWwiIG92ZXJmbG93PSJ2aXNpYmxlIiBjbGlwPSIwIiByb3RhdGlvbj0iMCIvPjxyZXN0b3JlLz48c2F2ZS8+PHNjYWxlIHNjYWxlPSIxIi8+PHN0cm9rZWNvbG9yIGNvbG9yPSIjMDAwMDAwIi8+PGJlZ2luLz48bW92ZSB4PSIxNjU2IiB5PSI3ODciLz48bGluZSB4PSIxNzQzLjMiIHk9Ijc4NyIvPjxsaW5lIHg9IjE3NDMuMyIgeT0iOTQ3Ii8+PGxpbmUgeD0iMTgyNC4xMyIgeT0iOTQ3Ii8+PHN0cm9rZS8+PGZpbGxjb2xvciBjb2xvcj0iIzAwMDAwMCIvPjxiZWdpbi8+PG1vdmUgeD0iMTgyOS4zOCIgeT0iOTQ3Ii8+PGxpbmUgeD0iMTgyMi4zOCIgeT0iOTUwLjUiLz48bGluZSB4PSIxODI0LjEzIiB5PSI5NDciLz48bGluZSB4PSIxODIyLjM4IiB5PSI5NDMuNSIvPjxjbG9zZS8+PGZpbGxzdHJva2UvPjxyZXN0b3JlLz48c2F2ZS8+PHNjYWxlIHNjYWxlPSIxIi8+PGZpbGxjb2xvciBjb2xvcj0iI0NDRkZGRiIvPjxzdHJva2Vjb2xvciBjb2xvcj0iIzAwMDAwMCIvPjxyZWN0IHg9IjE1MzYiIHk9Ijc1NyIgdz0iMTIwIiBoPSI2MCIvPjxmaWxsc3Ryb2tlLz48cmVzdG9yZS8+PHNhdmUvPjxzY2FsZSBzY2FsZT0iMSIvPjxmaWxsY29sb3IgY29sb3I9IiNDQ0ZGRkYiLz48c3Ryb2tlY29sb3IgY29sb3I9IiMwMDAwMDAiLz48Zm9udHNpemUgc2l6ZT0iMTIiLz48dGV4dCB4PSIxNTk2IiB5PSI3ODciIHc9IjExNiIgaD0iNTYiIHN0cj0iU3Vycm91bmQgQ2FtZXJhcyIgYWxpZ249ImNlbnRlciIgdmFsaWduPSJtaWRkbGUiIHdyYXA9IjEiIGZvcm1hdD0iaHRtbCIgb3ZlcmZsb3c9InZpc2libGUiIGNsaXA9IjAiIHJvdGF0aW9uPSIwIi8+PHJlc3RvcmUvPjxzYXZlLz48c2NhbGUgc2NhbGU9IjEiLz48c3Ryb2tlY29sb3IgY29sb3I9IiMwMDAwMDAiLz48YmVnaW4vPjxtb3ZlIHg9IjE5ODAuNSIgeT0iNzY3Ii8+PGxpbmUgeD0iMjA2My4zIiB5PSI3NjciLz48bGluZSB4PSIyMDYzLjMiIHk9Ijc4NyIvPjxsaW5lIHg9IjIxMzkuNjMiIHk9Ijc4NyIvPjxzdHJva2UvPjxmaWxsY29sb3IgY29sb3I9IiMwMDAwMDAiLz48YmVnaW4vPjxtb3ZlIHg9IjIxNDQuODgiIHk9Ijc4NyIvPjxsaW5lIHg9IjIxMzcuODgiIHk9Ijc5MC41Ii8+PGxpbmUgeD0iMjEzOS42MyIgeT0iNzg3Ii8+PGxpbmUgeD0iMjEzNy44OCIgeT0iNzgzLjUiLz48Y2xvc2UvPjxmaWxsc3Ryb2tlLz48cmVzdG9yZS8+PHNhdmUvPjxzY2FsZSBzY2FsZT0iMSIvPjxzdHJva2Vjb2xvciBjb2xvcj0iIzAwMDAwMCIvPjxiZWdpbi8+PG1vdmUgeD0iMTk4MC41IiB5PSI4MTIiLz48bGluZSB4PSIyMDYzLjMiIHk9IjgxMiIvPjxsaW5lIHg9IjIwNjMuMyIgeT0iODQyIi8+PGxpbmUgeD0iMjEzOS42MyIgeT0iODQyIi8+PHN0cm9rZS8+PGZpbGxjb2xvciBjb2xvcj0iIzAwMDAwMCIvPjxiZWdpbi8+PG1vdmUgeD0iMjE0NC44OCIgeT0iODQyIi8+PGxpbmUgeD0iMjEzNy44OCIgeT0iODQ1LjUiLz48bGluZSB4PSIyMTM5LjYzIiB5PSI4NDIiLz48bGluZSB4PSIyMTM3Ljg4IiB5PSI4MzguNSIvPjxjbG9zZS8+PGZpbGxzdHJva2UvPjxyZXN0b3JlLz48c2F2ZS8+PHNjYWxlIHNjYWxlPSIxIi8+PHN0cm9rZWNvbG9yIGNvbG9yPSIjMDAwMDAwIi8+PGJlZ2luLz48bW92ZSB4PSIxOTgwLjUiIHk9Ijg1NyIvPjxsaW5lIHg9IjIwNjMuMyIgeT0iODU3Ii8+PGxpbmUgeD0iMjA2My4zIiB5PSI5MTIiLz48bGluZSB4PSIyMTM5LjYzIiB5PSI5MTIiLz48c3Ryb2tlLz48ZmlsbGNvbG9yIGNvbG9yPSIjMDAwMDAwIi8+PGJlZ2luLz48bW92ZSB4PSIyMTQ0Ljg4IiB5PSI5MTIiLz48bGluZSB4PSIyMTM3Ljg4IiB5PSI5MTUuNSIvPjxsaW5lIHg9IjIxMzkuNjMiIHk9IjkxMiIvPjxsaW5lIHg9IjIxMzcuODgiIHk9IjkwOC41Ii8+PGNsb3NlLz48ZmlsbHN0cm9rZS8+PHJlc3RvcmUvPjxzYXZlLz48c2NhbGUgc2NhbGU9IjEiLz48ZmlsbGNvbG9yIGNvbG9yPSIjQ0NFNUZGIi8+PHN0cm9rZWNvbG9yIGNvbG9yPSIjMDAwMDAwIi8+PHJlY3QgeD0iMTgwMC41IiB5PSI3MjIiIHc9IjE4MCIgaD0iMTgwIi8+PGZpbGxzdHJva2UvPjxyZXN0b3JlLz48c2F2ZS8+PHNjYWxlIHNjYWxlPSIxIi8+PGZpbGxjb2xvciBjb2xvcj0iI0NDRTVGRiIvPjxzdHJva2Vjb2xvciBjb2xvcj0iIzAwMDAwMCIvPjxmb250c2l6ZSBzaXplPSIxMiIvPjx0ZXh0IHg9IjE4OTAuNSIgeT0iODEyIiB3PSIxNzYiIGg9IjE3NiIgc3RyPSJBREFTIERvbWFpbiBDb250cm9sbGVyIiBhbGlnbj0iY2VudGVyIiB2YWxpZ249Im1pZGRsZSIgd3JhcD0iMSIgZm9ybWF0PSJodG1sIiBvdmVyZmxvdz0idmlzaWJsZSIgY2xpcD0iMCIgcm90YXRpb249IjAiLz48cmVzdG9yZS8+PHNhdmUvPjxzY2FsZSBzY2FsZT0iMSIvPjxmaWxsY29sb3IgY29sb3I9IiNENUU4RDQiLz48c3Ryb2tlY29sb3IgY29sb3I9IiMwMDAwMDAiLz48cmVjdCB4PSIyMTQ2IiB5PSI3NTciIHc9IjEyMCIgaD0iNjAiLz48ZmlsbHN0cm9rZS8+PHJlc3RvcmUvPjxzYXZlLz48c2NhbGUgc2NhbGU9IjEiLz48ZmlsbGNvbG9yIGNvbG9yPSIjRDVFOEQ0Ii8+PHN0cm9rZWNvbG9yIGNvbG9yPSIjMDAwMDAwIi8+PGZvbnRzaXplIHNpemU9IjEyIi8+PHRleHQgeD0iMjIwNiIgeT0iNzg3IiB3PSIxMTYiIGg9IjU2IiBzdHI9IkFCUyIgYWxpZ249ImNlbnRlciIgdmFsaWduPSJtaWRkbGUiIHdyYXA9IjEiIGZvcm1hdD0iaHRtbCIgb3ZlcmZsb3c9InZpc2libGUiIGNsaXA9IjAiIHJvdGF0aW9uPSIwIi8+PHJlc3RvcmUvPjxzYXZlLz48c2NhbGUgc2NhbGU9IjEiLz48ZmlsbGNvbG9yIGNvbG9yPSIjRDVFOEQ0Ii8+PHN0cm9rZWNvbG9yIGNvbG9yPSIjMDAwMDAwIi8+PHJlY3QgeD0iMjE0NiIgeT0iODI3IiB3PSIxMjAiIGg9IjYwIi8+PGZpbGxzdHJva2UvPjxyZXN0b3JlLz48c2F2ZS8+PHNjYWxlIHNjYWxlPSIxIi8+PGZpbGxjb2xvciBjb2xvcj0iI0Q1RThENCIvPjxzdHJva2Vjb2xvciBjb2xvcj0iIzAwMDAwMCIvPjxmb250c2l6ZSBzaXplPSIxMiIvPjx0ZXh0IHg9IjIyMDYiIHk9Ijg1NyIgdz0iMTE2IiBoPSI1NiIgc3RyPSJFbmdpbmUgQ29udHJvbCBNb2R1bGUiIGFsaWduPSJjZW50ZXIiIHZhbGlnbj0ibWlkZGxlIiB3cmFwPSIxIiBmb3JtYXQ9Imh0bWwiIG92ZXJmbG93PSJ2aXNpYmxlIiBjbGlwPSIwIiByb3RhdGlvbj0iMCIvPjxyZXN0b3JlLz48c2F2ZS8+PHNjYWxlIHNjYWxlPSIxIi8+PGZpbGxjb2xvciBjb2xvcj0iI0Q1RThENCIvPjxzdHJva2Vjb2xvciBjb2xvcj0iIzAwMDAwMCIvPjxyZWN0IHg9IjIxNDYiIHk9Ijg5NyIgdz0iMTIwIiBoPSI2MCIvPjxmaWxsc3Ryb2tlLz48cmVzdG9yZS8+PHNhdmUvPjxzY2FsZSBzY2FsZT0iMSIvPjxmaWxsY29sb3IgY29sb3I9IiNENUU4RDQiLz48c3Ryb2tlY29sb3IgY29sb3I9IiMwMDAwMDAiLz48Zm9udHNpemUgc2l6ZT0iMTIiLz48dGV4dCB4PSIyMjA2IiB5PSI5MjciIHc9IjExNiIgaD0iNTYiIHN0cj0iRWxlY3RyaWMgUG93ZXIgU3RlZXJpbmciIGFsaWduPSJjZW50ZXIiIHZhbGlnbj0ibWlkZGxlIiB3cmFwPSIxIiBmb3JtYXQ9Imh0bWwiIG92ZXJmbG93PSJ2aXNpYmxlIiBjbGlwPSIwIiByb3RhdGlvbj0iMCIvPjxyZXN0b3JlLz48L291dHB1dD48L3N0YXRlPjwvcm9vdD4=}]
block :3 implements -1:158155:20805:1:010420241753#The Low Speed Manoeuvre Module shall go into Search State if  vehicle velocity is under 15 kph.: (untitled3/Constant1 -> The Low Speed Manoeuvre Module shall go into Search State if vehicle velocity is under 15 kph.) .
block :3 implements -1:158155:20806:1:010420241753#The Low Speed Manoeuvre Module shall go into Interrupted State if  the Door signal is Any Opened: (untitled3/Constant1 -> The Low Speed Manoeuvre Module shall go into Interrupted State if the Door signal is Any Opened) .
block :4 implements -1:158160:21481:1:010420241754#New Sub-Systems Requirement: (untitled3/Data Type Conversion1 -> New Sub-Systems Requirement) New Sub~-Systems Requirement
block :5 implements -1:158173:20847:1:030420241422#Test if the system is able to detect perpendicular parking spaces which width is 1.25x the vehicle width.: (untitled3/test -> Test if the system is able to detect perpendicular parking spaces which width is 1.25x the vehicle width.) This is to be tested: \\[<<description>>|ISSUE:20830]
block :5 implements -1:158173:20848:1:030420241423#Test if the system requests emergency break activation, if the speed is above the activation limit (25kph) and a valid vehicle object is detected.: (untitled3/test -> Test if the system requests emergency break activation, if the speed is above the activation limit (25kph) and a valid vehicle object is detected.) This is to be tested: \\[<<description>>|ISSUE:20837]